# Dynamo graph build_gsi_grid.dyn "build_excavation_points" (Dynamo 2.18.1.5096)

python_script = Python()  # CPython3
# ---------- python_script.python (37 lines) ----------
import clr, importlib, os, sys

clr.AddReference("AecBaseMgd")
clr.AddReference("AeccDbMgd")
clr.AddReference("acmgd")
clr.AddReference("acdbmgd")

try:
    _LIB_ROOT = os.path.dirname(os.path.dirname(os.path.abspath(__file__)))
except NameError:
    _LIB_ROOT = r"C:\Arhyz\automation\scripts"

_AUTOMATION_ROOT = os.path.dirname(_LIB_ROOT)

if _LIB_ROOT not in sys.path:
    sys.path.insert(0, _LIB_ROOT)
if _AUTOMATION_ROOT not in sys.path:
    sys.path.insert(0, _AUTOMATION_ROOT)

for _name in [m for m in list(sys.modules) if m.startswith("build_gsi_grid")]:
    del sys.modules[_name]
for _name in sorted(
    [m for m in sys.modules if m.startswith("civil")],
    reverse=True,
):
    try:
        importlib.reload(sys.modules[_name])
    except Exception:
        pass

from build_gsi_grid.builder import GsiGridBuilder

# Step 1 of the new GSI layout: pick OUTER / MIDDLE / INNER polylines, then draw the
# construction grid at each acute (<90 deg) corner -- a blue diagonal (outer vertex ->
# inner vertex) and magenta perpendiculars (dropped from a vertex onto an edge, kept only
# where the foot lands on the actual edge segment). No IN[] needed.
OUT = GsiGridBuilder().run()
# ----------------------------------------
